# Grasshopper definition Habeetat.gh (Grasshopper 1.0.7)
# plug-ins: Human, Pufferfish, MetaHopper, Human UI

# ----
# LOCATION
path = FilePath("C:\MUTIA OLFACTORY\THESIS\experiment\DNK_Copenhagen.061800_IWEC.epw")
importloc = LBImportLocation(epw_file=path)  # -> location; plug-in component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

# ----
# HABITAT TYPE
# CONDITION
# STRATEGY
value_list = ValueList({"BAREGROUND/PARK": 2, "VEGETATED GARDEN": 2, "RAIN GARDEN": 2, "DEVELOPED LAND/SEALED SURFACE": 0, "BUILT LINEAR FEATURE": 0, "()": 0}, selected="()")
value_list_2 = ValueList({"LOCAL STRATEGY": 1,15, "ECOLOGICALY DESIRABLE BUT NOT LOCAL": 1,1, "NOT BOTH OF LOCAL AND ECOLOGICAL": 1, "()": 0}, selected="()")
value_list_3 = ValueList({"GOOD": 3, "MODERATE": 2, "POOR": 1, "()": 0}, selected="()")

# ----
# EXISTING TREES?
panel = Panel(importloc)

# ----
# These features will give you options to frame the site
# and making cluster of neighborhood
value_list_4 = ValueList({"LINE OF TREES": 0, "NATIVE HEDGEROW": 0, "NATIVE HEDGEROW WITH TREES": 2, "SEALED SURFACE": 0, "SPECIES RICH HEDGEROW": 2, "SPECIES RICH HEDGEROW WITH TREES": 4, "()": 0}, selected="()")

# ---- group: Arrange Cluster Layout
number_slider = Slider(4, range=0..30)

# ----
# CONDITION
# STRATEGY
value_list_5 = ValueList({"GOOD": 3, "MODERATE": 2, "POOR": 1, "()": 0}, selected="()")
value_list_6 = ValueList({"LOCAL STRATEGY": 1,15, "ECOLOGICALY DESIRABLE BUT NOT LOCAL": 1,1, "NOT BOTH OF LOCAL AND ECOLOGICAL": 1, "()": 0}, selected="()")

# ----
# AREA
show = BooleanToggle(False)

value_list_7 = ValueList({"LOCAL STRATEGY": 1,15, "ECOLOGICALY DESIRABLE BUT NOT LOCAL": 1,1, "NOT BOTH OF LOCAL AND ECOLOGICAL": 1, "()": 0}, selected="()")
value_list_8 = ValueList({"GOOD": 3, "MODERATE": 2, "POOR": 1, "()": 0}, selected="()")
value_list_9 = ValueList({"LINE OF TREES": LOW, "NATIVE HEDGEROW": LOW, "NATIVE HEDGEROW WITH TREES": MEDIUM, "SEALED SURFACE": VERY LOW, "SPECIES RICH HEDGEROW": MEDIUM, "SPECIES RICH HEDGEROW WITH TREES": HIGH, "()": 0}, selected="()")

value_list_10 = ValueList({"LOCAL STRATEGY": 1,15, "ECOLOGICALY DESIRABLE BUT NOT LOCAL": 1,1, "NOT BOTH OF LOCAL AND ECOLOGICAL": 1, "()": 0}, selected="()")
value_list_11 = ValueList({"BAREGROUND/PARK": 2, "VEGETATED GARDEN": 2, "RAIN GARDEN": 2, "DEVELOPED LAND/SEALED SURFACE": 0, "BUILT LINEAR FEATURE": 0, "()": 0}, selected="()")

# ---- group: Arrange Your share Built Area with Nature
# These features will give you plotting options between buildings,
# and diferrent type of habitats around them).
# Click true to show the design. Modify the features on the left side
number_slider_2 = Slider(3, range=0..15)

# ---- group: Slide to provide shared garden
number_slider_3 = Slider(2, range=0..10)

# ---- group: Arrange how much shared garden
number_slider_4 = Slider(2, range=0..10)

# ----
# CONDITION
# STRATEGY
value_list_12 = ValueList({"GOOD": 3, "MODERATE": 2, "POOR": 1, "()": 0}, selected="()")
value_list_13 = ValueList({"LOCAL STRATEGY": 1,15, "ECOLOGICALY DESIRABLE BUT NOT LOCAL": 1,1, "NOT BOTH OF LOCAL AND ECOLOGICAL": 1, "()": 0}, selected="()")

# ----
# SHOW TREES LANDSCAPE
show_2 = BooleanToggle(False)

# ----
# 3
show_3 = BooleanToggle(True)

# ----
# USE GREEN ROOF?
number_slider_5 = Slider(3, range=0..10)

# ----
# TREE GREEN ROOF
# GARDEN PLANTS
value_list_14 = ValueList({"Kornvalmue (Papaver Rhoeas)", "Almindelig merian(Origanum vulgare)", "Origanum vulgare (white flowered)", "Echium vulgare", "Centaurea Scabiosa", "Echium vulgare \"blue bedder": "Echium vulgare "blue bedder"", "Anthemis tinctoria", "Thymus vulgare", "Silene dioica", "Knautia arvensis", "Campanula persicifolia", "valerian officinalis", "Stachys sylvatica", "Vaccinium corymbosum L", "Solanum lycopersicum var. Cerasiforme", "Grass", "Autumn crocus (Colchicum autumnale)"}, selected=[])
python = GhPythonScript(Plants_choice=value_list_14)  # -> flatten(Pollinators_invited), flatten(Effects_human)
# ---------- python: Python ----------
import rhinoscriptsyntax as rs
if Plants_choice == "Kornvalmue (Papaver Rhoeas)":
    Pollinators_invited = "Honey bee", "Bumble bee", "Solitary bee", "Lepidoptera", "Hoverfly", "Song Birds"
elif Plants_choice == "Echium vulgare":
    Pollinators_invited = "Honey bee", "Bumble bee", "Solitary bee", "Lepidoptera", "Hoverfly"
    Effects_human = "Skin irritation", "Toxic food"
elif Plants_choice == "Almindelig merian(Origanum vulgare)":
    Pollinators_invited = "Honey bee", "Bumble bee", "Solitary bee", "Lepidoptera", "Hoverfly"
elif Plants_choice == "Centaurea Scabiosa":
    Pollinators_invited = "Honey bee", "Bumble bee", "Solitary bee", "Lepidoptera", "Hoverfly"
    Effects_human = "Food"
elif Plants_choice == "Origanum vulgare (white flowered)":
    Pollinators_invited = "Honey bee", "Bumble bee", "Solitary bee", "Lepidoptera", "Hoverfly"
elif Plants_choice == "Anthemis tinctoria":
    Pollinators_invited = "Solitary bee", "Lepidoptera", "Hoverfly", "Song Birds"
elif Plants_choice == "Thymus vulgare":
    Pollinators_invited = "Solitary bee", "Hoverfly"
    Effects_human = "Food"
elif Plants_choice == "Grass":
    Pollinators_invited = "Honey bee", "Solitary bee", "Hoverfly", "Song Birds"
    Effects_human = "Allergies", "Recreation"
elif Plants_choice == "Autumn crocus (Colchicum autumnale)":
    Pollinators_invited = "Honey bee", "Bumble bee", "Solitary bee", "Hoverfly"
    Effects_human = "Toxic food"
elif Plants_choice == "Vaccinium corymbosum L":
    Pollinators_invited = "Honey bee", "Bumble bee", "Solitary bee", "Hoverfly"
    Effects_human = "Food"


print Pollinators_invited
print Effects_human
# ---------- end python ----------

# ----
# HABITAT
# CONDITION
# STRATEGY
value_list_15 = ValueList({"INTENSIVE GREEN ROOF": 2, "BIODIVERSE GREEN ROOF": 4, "OTHER GREEN ROOF": 2, "()": 0}, selected="()")
value_list_16 = ValueList({"LOCAL STRATEGY": 1,15, "ECOLOGICALY DESIRABLE BUT NOT LOCAL": 1,1, "NOT BOTH OF LOCAL AND ECOLOGICAL": 1, "()": 0}, selected="()")
value_list_17 = ValueList({"GOOD": 3, "MODERATE": 2, "POOR": 1, "()": 0}, selected="()")

# ----
# HABITAT
# CONDITION
# STRATEGY
value_list_18 = ValueList({"INTENSIVE GREEN ROOF": 2, "BIODIVERSE GREEN ROOF": 4, "OTHER GREEN ROOF": 2, "()": 0}, selected="()")
value_list_19 = ValueList({"LOCAL STRATEGY": 1,15, "ECOLOGICALY DESIRABLE BUT NOT LOCAL": 1,1, "NOT BOTH OF LOCAL AND ECOLOGICAL": 1, "()": 0}, selected="()")
value_list_20 = ValueList({"GOOD": 3, "MODERATE": 2, "POOR": 1, "()": 0}, selected="()")

# ----
# HABITAT
# CONDITION
# STRATEGY
value_list_21 = ValueList({"Ground-based GW": 2, "Face-bound GW": 2}, selected=[])
value_list_22 = ValueList({"GOOD", "MODERATE", "POOR", "()"}, selected="()")
value_list_23 = ValueList({"LOCAL STRATEGY": 1,15, "ECOLOGICALY DESIRABLE BUT NOT LOCAL": 1,1, "NOT BOTH OF LOCAL AND ECOLOGICAL": 1, "()": 0}, selected="()")

# ----
# GREEN WALL
# PLANTS
value_list_24 = ValueList({"Ivy (Hedera Helix)", "Vildvin(Parthenocissus)"}, selected=[])

# ----
# ARRANGE
# GREEN WALL
building_type_1 = Slider(1, range=0..100)
building_type_2 = Slider(4, range=0..100)

# ----
# GREEN ROOF
show_4 = BooleanToggle(False)

# ----
# GREEN WALL
show_5 = BooleanToggle(False)

# ----
# YES
# 
# NO
toggle = BooleanToggle(False)

# ----
# 4
# SHOW 3D BUILDING
show_6 = BooleanToggle(False)

# ----
# 5
# ASSESSMENT
toggle_2 = BooleanToggle(True)

# ----
# SHOW DETAILS
# HABITAT UNIT
# CREATED
# HABITAT AREA
# CREATED
click = BooleanToggle(False)

# ----
# SOCIAL CONNECTIVITY
show_7 = BooleanToggle(False)

# ----
# SAFE MIGRATORY
show_8 = BooleanToggle(False)

# ----
# SYMBIOSIS
# BIOPHILIA
show_9 = BooleanToggle(False)

# ----
# ECOLOGICAL CONNECTIVITY
show_10 = BooleanToggle(False)

python_2 = GhPythonScript(x=[value_list_20, value_list_17, value_list_8, value_list_5])  # -> out, a
# ---------- python_2: Python ----------
__author__ = "LENOVO-PC"
__version__ = "2023.05.16"

import rhinoscriptsyntax as rs
if x == 3:
    a = 5
elif x == 2:
    a = 3
elif x == 1:
    a = 1
else :
    a = 0

print a
# ---------- end python_2 ----------

area = Area()  # -> flatten(Area), Centroid
ma = MassAddition(Input=area.Area)  # -> Result, PartialResults

python_3 = GhPythonScript(x=value_list_24)  # -> flatten(Pollinators_Invited), flatten(Environmental_benefits), flatten(Effects_human)
# ---------- python_3: Python ----------
import rhinoscriptsyntax as rs
if x == "Ivy (Hedera Helix)":
    Environmental_benefits = "Wind breaker", "Storm water service"
    Pollinators_Invited = "Honey bee", "Lepidoptera", "Song Birds"
    Effects_human = "Biophilia"
if x == "Vildvin(Parthenocissus)":
    Environmental_benefits = "Wind breaker", "Storm water service"
    Pollinators_Invited = "Honey bee", "Lepidoptera", "Song Birds"
    Effects_human = "Biophilia"
 
print Environmental_benefits
print Effects_human
print Pollinators_Invited
# ---------- end python_3 ----------

area_2 = Area()  # -> Area, Centroid
ma_2 = MassAddition(Input=flatten(area_2.Area))  # -> Result, PartialResults

cset = CreateSet(List=python_3.Effects_human)  # -> Set, Map
cset_2 = CreateSet(List=python_3.Environmental_benefits)  # -> Set, Map
cset_3 = CreateSet(List=python_3.Pollinators_Invited)  # -> Set, Map

environment = Panel(cset_2.Set)
pollinators = Panel(cset_3.Set)
human_effects = Panel(cset.Set)

hideshow = HideShowObjectPreview(Visible=show_4, AllObjects_Object=custom_preview_lineweights_16)
hideshow_2 = HideShowObjectPreview(Visible=show_2, AllObjects_Object=custom_preview_lineweights_15)
hideshow_3 = HideShowObjectPreview(Visible=show_9, AllObjects_Object=[conmesh_2, conmesh])
hideshow_4 = HideShowObjectPreview(
    Visible=show_3,
    AllObjects_Object=[custom_preview_lineweights_5, custom_preview_lineweights_10, custom_preview_lineweights_12, custom_preview_lineweights_13])
hideshow_5 = HideShowObjectPreview(Visible=show_7, AllObjects_Object=legend)
hideshow_6 = HideShowObjectPreview(Visible=show_8, AllObjects_Object=hideshow_6)
hideshow_7 = HideShowObjectPreview(Visible=show_10, AllObjects_Object=[preview_2, legend_2])
hideshow_8 = HideShowObjectPreview(Visible=show, AllObjects_Object=[screentext_4, screentext_5])
hideshow_9 = HideShowObjectPreview(Visible=show_6, AllObjects_Object=custom_preview_lineweights_6)
hideshow_10 = HideShowObjectPreview(AllObjects_Object=[custom_preview_lineweights_8, custom_preview_lineweights_9, custom_preview_lineweights])
hideshow_11 = HideShowObjectPreview(Visible=show_5, AllObjects_Object=[previewlw, previewlw_2])

hideshow_12 = HideShowObjectPreview(Visible=Toggle(False), AllObjects_Object=custom_preview_lineweights_7)

hideshow_13 = HideShowObjectPreview(Visible=show_10, AllObjects_Object=[preview_2, legend_2])
hideshow_14 = HideShowObjectPreview(Visible=show_7, AllObjects_Object=[legend, preview])

multiplication = Multiplication(A=value_list_15, B=value_list_17, C=value_list_16, D=value_list_2)
division = Division(A=multiplication, B=10000)

# ----
# GREEN ROOF EXTENSIVE
trim = TrimWithRegion()  # -> Inside, Outside
boundary = BoundarySurfaces(Edges=trim.Outside)
custom_preview_lineweights = CustomPreviewLineweights(Geometry=boundary, Shader=ColourSwatch(SwatchColor=RGB(97, 210, 0)), Absolute=False)

X = UnitX(Factor=Slider(-800, range=-800..0))
X_2 = UnitX(Factor=Slider(-800, range=-800..0))

multiplication_2 = Multiplication(B=value_list_9, C=value_list_3, D=value_list_2)
division_2 = Division(A=multiplication_2, B=10000)

# ----
# CONDITION
# STRATEGY
value_list_25 = ValueList({"RØN (Sorbus Hybrida": "RØN (Sorbus Hybrida)", "RUBINIA (Robinia pseudoacacia)", "PLATAN (Plantear)", "ELM (Ulmus glabra)", "BETULA PENDULA", "KIRSBÆR (Ceresia)"}, selected=[])
canopy_wide = Slider(3, range=0..10)
how_many_trees = Slider(10, range=0..10)
value_list_26 = ValueList({"LOCAL STRATEGY": 1,15, "ECOLOGICALY DESIRABLE BUT NOT LOCAL": 1,1, "NOT BOTH OF LOCAL AND ECOLOGICAL": 1, "()": 0}, selected="LOCAL STRATEGY")
value_list_27 = ValueList({"GOOD": 3, "MODERATE": 2, "POOR": 1, "()": 0}, selected="MODERATE")

python_4 = GhPythonScript(Tree_choice=value_list_25)  # -> flatten(Pollinators_Invited), flatten(Environmental_benefits), flatten(Effects_human)
# ---------- python_4: Python ----------
import rhinoscriptsyntax as rs
if Tree_choice == "RØN (Sorbus Hybrida)":
    Environmental_benefits = "Wind breaker", "Storm water service"
    Effects_human = "Allergies", "Biophilia", "Shading"
    Pollinators_Invited = "Song Birds"
if Tree_choice == "RUBINIA (Robinia pseudoacacia)":
    Environmental_benefits = "Wind breaker", "Storm water service"
    Effects_human = "Allergies", "Biophilia", "Shading"
    Pollinators_Invited = "Honey bee", "Lepidoptera", "Song Birds"
if Tree_choice == "PLATAN (Plantear)":
    Environmental_benefits = "Wind breaker", "Storm water service"
    Effects_human = "Allergies", "Biophilia", "Shading"
    Pollinators_Invited = "Hoverfly", "Song Birds"
if Tree_choice == "BETULA PENDULA":
    Environmental_benefits = "Wind breaker", "Storm water service"
    Effects_human = "Allergies", "Biophilia", "Shading"
    Pollinators_Invited = "Hoverfly", "Song Birds"

 
print Environmental_benefits
print Effects_human
print Pollinators_Invited
# ---------- end python_4 ----------
cset_4 = CreateSet(List=python_4.Pollinators_Invited)  # -> Set, Map
mindex = MemberIndex(Set=python_4.Pollinators_Invited, Member=cset_4.Set)  # -> Index, Count
cset_5 = CreateSet(List=python_4.Effects_human)  # -> Set, Map
mindex_2 = MemberIndex(Set=python_4.Effects_human, Member=cset_5.Set)  # -> Index, Count
cset_6 = CreateSet(List=python_4.Environmental_benefits)  # -> Set, Map
mindex_3 = MemberIndex(Set=python_4.Environmental_benefits, Member=cset_6.Set)  # -> Index, Count

# ----
# DETAILS
# (BEFORE)
panel_2 = Panel(cset_4.Set)
panel_3 = Panel(cset_5.Set)
panel_4 = Panel(cset_6.Set)

multiplication_3 = Multiplication(A=canopy_wide, B=how_many_trees)
multiplication_4 = Multiplication(A=multiplication_3, B=value_list_27, C=value_list_26)
division_3 = Division(A=multiplication_4, B=10000)

area_3 = Panel(multiplication_3)
habitat_unit = Panel(division_3)

# ----
# HABEETAT
# SITE
area_plot_neighborhoof = Curve(<curve referenced from the Rhino model>)

Z = UnitZ(Factor=[Slider(15, range=0..100), Slider(2, range=0..10), Slider(100, range=0..100)])
extr = Extrude(Base=area_plot_neighborhoof, Direction=Z)
debrep = DeconstructBrep(Brep=extr)  # -> Faces, Edges, Vertices
sdivide = DivideSurface(Surface=debrep.Faces, UCount=Slider(1, range=0..10), VCount=10)  # -> Points, Normals, Parameters
pline = PolyLine(Vertices=sdivide.Points, Closed=False)
dash = DashPattern(Curve=pline, Pattern=sdivide.Normals)  # -> Dashes, Gaps
crv = Curve(dash.Dashes)
item = ListItem(List=extr, Index=0, Wrap=True)  # -> flatten(Item)
item_2 = ListItem(List=extr, Index=Slider(1, range=0..100), Wrap=True)  # -> flatten(Item)
item_3 = ListItem(List=extr, Index=Slider(2, range=0..10), Wrap=True)  # -> flatten(Item)
number_slider_6 = Slider(8, range=0..10)
pop3d = Populate3D(Region=item, Count=Slider(1, range=0..1), Seed=crv)
pop3d_2 = Populate3D(Region=item_3, Count=Slider(1, range=0..1), Seed=crv)
pop3d_3 = Populate3D(Region=item_2, Count=Slider(1, range=0..1), Seed=crv)

screentext = ScreenOrientedText(Text="BUTTERFLY, HOVERFLY", Justification=7, Location=pop3d, SizeFactor=Slider(8, range=0..10), Depth=0, Absolute=False)
screentext_2 = ScreenOrientedText(Text="DRAGONFLY, BUGS, ANTS", Justification=7, Location=pop3d_3, SizeFactor=number_slider_6, Depth=0, Absolute=False)
screentext_3 = ScreenOrientedText(Text="SONG BIRD'", Justification=7, Location=pop3d_2, SizeFactor=number_slider_6, Depth=0, Absolute=False)

# ----
# SITE FRAMING
# HEDGE
N = Slider(0, range=-30..0)
# CREATE CLUSTER
layer_1 = Slider(6, range=0..15)
layer_3 = Slider(1, range=0..10)
layer_2 = Slider(4, range=0..10)

offset = OffsetCurve(Curve=area_plot_neighborhoof, Distance=N, Corners=1)
loft = Loft(
    Curves=flatten([area_plot_neighborhoof, offset]),
    Options={Adjust=False, Closed=False, LoftEnds=0, LoftSimp=0, LoftType=0, Rebuild=10, Refit=0.01})
boundary_2 = BoundarySurfaces(Edges=offset)
area_4 = Area(Geometry=loft)  # -> Area, Centroid

# ----
# 2
area_5 = Panel(area_4.Area)

multiplication_5 = Multiplication(A=area_5, B=value_list_4, C=value_list_5, D=value_list_6)
division_4 = Division(A=multiplication_5, B=10000)

# ----
# HABITAT CREATION
# HEDGE
panel_5 = Panel(division_4)

# ---- group: WILDERNESS AREA
custom_preview_lineweights_2 = CustomPreviewLineweights(Geometry=boundary_2, Shader=ColourSwatch(SwatchColor=RGB(0, 109, 29)), Absolute=False)

# ---- group: URBAN TREE
custom_preview_lineweights_3 = CustomPreviewLineweights(Geometry=loft, Shader=ColourSwatch(SwatchColor=RGB(84, 177, 99)), Absolute=False)

# ----
# BUILDING PLOTTING
value_list_28 = ValueList({"BAREGROUND/PARK": 2, "VEGETATED GARDEN": 2, "RAIN GARDEN": 2, "DEVELOPED LAND/SEALED SURFACE": 0, "BUILT LINEAR FEATURE": 0}, selected="DEVELOPED LAND/SEALED SURFACE")

# ----
# LAND USE
value_list_29 = ValueList({"RØN (Sorbus Hybrida)": 2, "RUBINIA (Robinia pseudoacacia)": 2, "PLATAN (Plantear)": 2, "ELM (Ulmus glabra)": 1, "BETULA PENDULA": 1, "KIRSBÆR (Ceresia)": 2}, selected=[])

# ----
# TREES LANDSCAPE
how_many_trees_2 = Slider(0, range=0..10)

# ----
# LAYERS OF GREEN  PATCHES
# GREEN AREA LAYOUT
number_slider_7 = Slider(2, range=0..10)

# ----
# TYPE 1
# Base type
# TYPE 2
# Base type
value_list_30 = ValueList({"BAREGROUND/PARK": 2, "VEGETATED GARDEN": 2, "RAIN GARDEN": 2, "DEVELOPED LAND/SEALED SURFACE": 0, "BUILT LINEAR FEATURE": 0}, selected="BUILT LINEAR FEATURE")
height = Slider(20, range=0..20)
height_2 = Panel(height)
# This feature allows you to put your preferences building height (m),
#  type of green roof, amount of trees on green roof,
# green wall. Click True to show the 3D. Change the features on the left side
# BUILDING FEATURE
# CONFIGURATION
number_slider_8 = Slider(2, range=0..10)
value_list_31 = ValueList({"BAREGROUND/PARK": 2, "VEGETATED GARDEN": 2, "RAIN GARDEN": 2, "DEVELOPED LAND/SEALED SURFACE": 0, "BUILT LINEAR FEATURE": 0}, selected="DEVELOPED LAND/SEALED SURFACE")
height_3 = Slider(30, range=0..100)
height_4 = Panel(height_3)

# ----
# CONDITION
# STRATEGY
value_list_32 = ValueList({"RØN (Sorbus Hybrida": "RØN (Sorbus Hybrida)", "RUBINIA (Robinia pseudoacacia)", "PLATAN (Plantear)", "ELM (Ulmus glabra)", "BETULA PENDULA", "KIRSBÆR (Ceresia)"}, selected=[])
canopy_wide_2 = Slider(2, range=0..10)
how_many_trees_3 = Slider(4, range=0..10)
value_list_33 = ValueList({"LOCAL STRATEGY": 1,15, "ECOLOGICALY DESIRABLE BUT NOT LOCAL": 1,1, "NOT BOTH OF LOCAL AND ECOLOGICAL": 1, "()": 0}, selected="()")
value_list_34 = ValueList({"GOOD": 3, "MODERATE": 2, "POOR": 1, "()": 0}, selected="()")

python_5 = GhPythonScript(Tree_choice=value_list_32)  # -> flatten(Pollinators_Invited), flatten(Environmental_benefits), flatten(Effects_human)
# ---------- python_5: Python ----------
import rhinoscriptsyntax as rs
if Tree_choice == "RØN (Sorbus Hybrida)":
    Environmental_benefits = "Wind breaker", "Storm water service"
    Effects_human = "Allergies", "Biophilia", "Shading"
    Pollinators_Invited = "Song Birds"
if Tree_choice == "RUBINIA (Robinia pseudoacacia)":
    Environmental_benefits = "Wind breaker", "Storm water service"
    Effects_human = "Allergies", "Biophilia", "Shading"
    Pollinators_Invited = "Honey bee", "Lepidoptera", "Song Birds"
if Tree_choice == "PLATAN (Plantear)":
    Environmental_benefits = "Wind breaker", "Storm water service"
    Effects_human = "Allergies", "Biophilia", "Shading"
    Pollinators_Invited = "Hoverfly", "Song Birds"
if Tree_choice == "BETULA PENDULA":
    Environmental_benefits = "Wind breaker", "Storm water service"
    Effects_human = "Allergies", "Biophilia", "Shading"
    Pollinators_Invited = "Hoverfly", "Song Birds"
if Tree_choice == "KIRSBÆR (Ceresia)":
    Pollinators_Invited = "Honey bee", "Solitary bee", "Song Birds"
    Effects_human = "Biophilia", "Shading", 

 
print Environmental_benefits
print Effects_human
print Pollinators_Invited
# ---------- end python_5 ----------
cset_7 = CreateSet(List=python_5.Environmental_benefits)  # -> Set, Map
cset_8 = CreateSet(List=python_5.Pollinators_Invited)  # -> Set, Map
cset_9 = CreateSet(List=python_5.Effects_human)  # -> Set, Map

environment_2 = Panel(cset_7.Set)
human_effects_2 = Panel(cset_9.Set)
pollinators_2 = Panel(cset_8.Set)

# ----
# DETAILS
# (AFTER)
panel_6 = Panel([python.Pollinators_invited, pollinators_2, pollinators])
panel_7 = Panel([environment, environment_2])

cset_10 = CreateSet(List=[panel_6, pollinators])  # -> Set, Map
mindex_4 = MemberIndex(Set=panel_6, Member=cset_10.Set)  # -> Index, Count
panel_8 = Panel(cset_10.Set)

mindex_5 = MemberIndex(Set=panel_7, Member=panel_7)  # -> Index, Count

python_6 = GhPythonScript(x=value_list_22)  # -> out, a, b
# ---------- python_6: Python ----------
import rhinoscriptsyntax as rs
if x == "GOOD":
    a = 3
    b = 5
elif x == "MODERATE":
    a = 2
    b = 3
elif x == "POOR":
    a = 1
    b = 1

print a
print b
# ---------- end python_6 ----------

year_estimation = Panel(python_6.b)

# ----
# CODES
python_7 = GhPythonScript(x=[value_list_34, value_list_12])  # -> out, a
# ---------- python_7: Python ----------
__author__ = "LENOVO-PC"
__version__ = "2023.05.16"

import rhinoscriptsyntax as rs
if x == 3:
    a = 30
elif x == 2:
    a = 27
elif x == 1:
    a = 10
else :
    a = 0

print a
# ---------- end python_7 ----------
multiplication_6 = Multiplication(A=how_many_trees_2)
python_8 = GhPythonScript(x=[value_list_18, value_list_15, value_list_11, value_list_17])  # -> out, a
# ---------- python_8: Python ----------
__author__ = "LENOVO-PC"
__version__ = "2023.05.16"

import rhinoscriptsyntax as rs
if x > 1:
    a = "Recreation"

print a
# ---------- end python_8 ----------
equalareagreedy = CSharpScript(pl=offset, n=layer_1)  # -> out, A; inputs pl: Polyline, n: Int32
# ---------- equalareagreedy: C# ----------
   /**
   * Polygon Splitting by Area developed by Martin Dennemark at Bauhaus University Weimar, DecodingSpaces & Form Follows You
   * Greatly based on Gediminas Rimša polyline split algorithm
   * https://github.com/grimsa/polysplit
   * which is derived from Sumit Khetarpal http://www.khetarpal.org/polygon-splitting/
   * Licensed under the MIT license.
   */
  
  
    if(!pl.IsClosed || !pl.IsValid){
      Print("Polyline is not valid");
    }
    if(n < 2){
      Print("Number of parts should be greater than 1!");
    }
    AreaMassProperties amp = AreaMassProperties.Compute(pl.ToNurbsCurve());
    double singlePartArea = amp.Area / (double) n;
    List<Polyline> polylineParts = new List<Polyline>();
    Polyline remainingPoly = pl;
    for(int i = 0; i < n - 1; i++){
      remainingPoly = split(remainingPoly, polylineParts, singlePartArea);
    }
    polylineParts.Add(remainingPoly);
    A = polylineParts;
# ---------- equalareagreedy: C# additional code ----------
  public Polyline split(Polyline polyline, List<Polyline> resultList, double singlePartArea){
    List<Line> segments = polyline.GetSegments().ToList();
    List<Cut> possibleCuts = new List<Cut>();
    AreaMassProperties amp = AreaMassProperties.Compute(polyline.ToNurbsCurve());

    for(int i = 0; i < segments.Count() - 2; i++){
      for(int j = i + 2; j < segments.Count();j++){
        int segmentsCovered = j - i + 1;
        if(segments.Count() == segmentsCovered){
          break;
        }
        Line edgeA = segments[i];
        Line edgeB = segments[j];

        EdgePair edgePair = new EdgePair(edgeA, edgeB);
        EdgePairSubpolylines subpolyline = edgePair.getSubpolylines();
        List<Cut> cutForCurrentEdgePair = subpolyline.getCuts(polyline, singlePartArea);
        possibleCuts.AddRange(cutForCurrentEdgePair);
      }
    }

    if(possibleCuts.Count > 0){
      Cut shortestCut = possibleCuts.Aggregate((minItem, nextItem) => minItem.getLength() < nextItem.getLength() ? minItem : nextItem);
      resultList.Add(shortestCut.getCutAway());

      return shortestCut.getCutRemain();}
    else return polyline;
  }
  public class Cut{
    private double length;
    private Polyline cutAway;
    private Polyline cutRemain;

    public Cut(double lengthOfCut, Polyline cutAway, Polyline cutRemain){
      this.length = lengthOfCut;
      this.cutAway = cutAway;
      this.cutRemain = cutRemain;
    }

    public double getLength(){
      return length;
    }
    public Polyline getCutAway(){
      return cutAway;
    }
    public Polyline getCutRemain(){
      return cutRemain;
    }

  }

 /**
 * Represents a pair of edges on polygon's exterior ring.
 * Warning: direction of edges is assumed to be the same as in the polygon's exterior ring.
 *
 * Possible lines of cut are located in one of:
 *
 * T1 - First triangle, may not exist in some cases
 * Trapezoid - Trapezoid, always present
 * T2 - Second triangle, may not exist in some cases
 *
 *
 *                                edgeA
 *            edgeA.p0 .____________________________. edgeA.p1
 *                    /|                            |\
 *                   /                                \
 *   outsideEdge2   /  |                            |  \   outsideEdge1
 *                 /                                    \
 *                / T2 |        Trapezoid           | T1 \
 *               /                                        \
 *              .______.____________________________|______.
 *        edgeB.p1                edgeB                    edgeB.p0
 *                     ^                            ^
 *                 projected1                  projected0
 *
 */

  class EdgePair{

    private Line edgeA;
    private Line edgeB;

    private Point3d projected0;
    private Point3d projected1;

    public EdgePair(Line edgeA, Line edgeB){

      double ia, ib;
      Point3d interesectionPoint = new Point3d(double.MaxValue, double.MaxValue, double.MaxValue);
      if(Rhino.Geometry.Intersect.Intersection.LineLine(edgeA, edgeB, out ia, out ib))
        interesectionPoint = edgeA.PointAt(ia);
      bool intersectionOnEdge = false;
      if(ia >= 0 && ia <= 1) intersectionOnEdge = true;
      if(ib >= 0 && ib <= 1) intersectionOnEdge = true;

      this.edgeA = edgeA;
      this.edgeB = edgeB;

      projected0 = getProjectedPoint(edgeA.To, edgeB, interesectionPoint, intersectionOnEdge);
      if(projected0.X == double.MaxValue){
        projected0 = getProjectedPoint(edgeB.From, edgeA, interesectionPoint, intersectionOnEdge);
      }

      projected1 = getProjectedPoint(edgeB.To, edgeA, interesectionPoint, intersectionOnEdge);

      if(projected1.X == double.MaxValue){
        projected1 = getProjectedPoint(edgeA.From, edgeB, interesectionPoint, intersectionOnEdge);
      }
    }
    public EdgePairSubpolylines getSubpolylines() {
      return new EdgePairSubpolylines(edgeA, edgeB, projected0, projected1);
    }


    private Point3d getProjectedPoint(Point3d point, Line opposingEdge, Point3d intPt, bool intersectionOnEdge){
      if(intPt.X != double.MaxValue){
        if(intersectionOnEdge){
          Vector3d vecPerpendicular = Vector3d.CrossProduct(opposingEdge.UnitTangent, Vector3d.ZAxis);
          Line perpendicularLine = new Line(intPt, vecPerpendicular);
          int orientationIndexOfPoint = OrientationOfPoint(perpendicularLine, point);
          double p = opposingEdge.ClosestParameter(intPt);
          if(p >= 0 && p <= 1){
            int orientationIndexOfStart = OrientationOfPoint(perpendicularLine, opposingEdge.From);

            if (orientationIndexOfPoint == orientationIndexOfStart) {
              // Start of opposingEdge is on the same side as the vertex (thus we shorten the segment discarding p1)
              opposingEdge = new Line(opposingEdge.From, intPt);

            } else {
              // End of opposingEdge is on the same side as the vertex (thus we shorten the segment discarding p0)
              opposingEdge = new Line(intPt, opposingEdge.To);
            }
          }
          else {
            // the intersection point is outside of the edge
            int orientationIndexOfEdge = OrientationOfPoint(perpendicularLine, opposingEdge.To);   // -1 or +1

            // TODO: need to handle edge pairs better
            //                    boolean vertexIsOnPerpendicularLine = orientationIndexOfVertex == 0;             // this is needed to handle cases when both edges are perpendicular to each other
            bool vertexIsOnPerpendicularLine = false;
            if (!vertexIsOnPerpendicularLine && orientationIndexOfPoint != orientationIndexOfEdge) {
              // projection of vertex is located somewhere on the opposite side of the intersection point (not on the edge)
              return new Point3d(double.MaxValue, double.MaxValue, double.MaxValue);

            }
            // otherwise it is on the same side - proceed as usual
          }
        }
        double distanceOfPoint = point.DistanceTo(intPt);


        double distOfOpEdgePoint1 = intPt.DistanceTo(opposingEdge.From);
        double distOfOpEdgePoint2 = intPt.DistanceTo(opposingEdge.To);
        if(distanceOfPoint >= Math.Max(distOfOpEdgePoint1, distOfOpEdgePoint2) || distanceOfPoint <= Math.Min(distOfOpEdgePoint1, distOfOpEdgePoint2))
        {
          return new Point3d(double.MaxValue, double.MaxValue, double.MaxValue);
        }

        Point3d furtherPoint = getFurtherEnd(intPt, opposingEdge);
        Line extendedOpposingEdge = new Line(intPt, furtherPoint);
        return extendedOpposingEdge.PointAt(distanceOfPoint / extendedOpposingEdge.Length);
      } else {
        // In case of parallel lines, we do not have an intersection point
        double p = opposingEdge.ClosestParameter(point);       // a projection onto opposingEdge (extending to infinity)
        if(p >= 0 && p <= 1){
          return opposingEdge.PointAt(p);
        }else
        {
          return new Point3d(double.MaxValue, double.MaxValue, double.MaxValue);
        }

      }
    }
    private int OrientationOfPoint(Line line, Point3d point){
      Point3d testPt;
      Plane pl = new Plane(line.From, line.UnitTangent, Vector3d.ZAxis);
      pl.RemapToPlaneSpace(point, out testPt);
      if(testPt.Z < 0)
        return -1;
      else if (testPt.Z > 0) return 1;
      else return 0;

    }
    public Point3d getFurtherEnd(Point3d point, Line line)
    {
      return point.DistanceTo(line.From) > point.DistanceTo(line.To) ? line.From : line.To;
    }


  }


  class EdgePairSubpolylines {
    private Line edgeA;
    private Line edgeB;

    private Polyline triangle1;
    private Polyline trapezoid;
    private Polyline triangle2;
    private double triangle1Area = 0;
    private double trapezoidArea = 0;
    private double triangle2Area = 0;

    public EdgePairSubpolylines(Line edgeA, Line edgeB, Point3d projected0, Point3d projected1){
      this.edgeA = edgeA;
      this.edgeB = edgeB;
      if(projected0.X != double.MaxValue){
        List<Point3d> pts = new List<Point3d>();
        pts.Add(edgeA.To);
        pts.Add(projected0);
        pts.Add(edgeB.From);
        pts.Add(edgeA.To);
        triangle1Area = CalculateTriangleArea(pts[0], pts[1], pts[2]);
        triangle1 = new Polyline(pts);
      }
      if(projected1.X != double.MaxValue){
        List<Point3d> pts = new List<Point3d>();
        pts.Add(edgeA.From);
        pts.Add(projected1);
        pts.Add(edgeB.To);
        pts.Add(edgeA.From);
        triangle2Area = CalculateTriangleArea(pts[0], pts[1], pts[2]);
        triangle2 = new Polyline(pts);
      }
      List<Point3d> ptsTrapezoid = new List<Point3d>();

      double tolerance = 0.0001;
      if(projected1.DistanceTo(edgeA.ClosestPoint(projected1, true)) < tolerance &&
      projected1.X != double.MaxValue){ptsTrapezoid.Add(projected1); }
      else ptsTrapezoid.Add(edgeA.From);
      if(projected0.DistanceTo(edgeA.ClosestPoint(projected0, true)) < tolerance &&
        projected0.X != double.MaxValue) ptsTrapezoid.Add(projected0);
      else ptsTrapezoid.Add(edgeA.To);
      if(projected0.DistanceTo(edgeB.ClosestPoint(projected0, true)) < tolerance &&
        projected0.X != double.MaxValue) ptsTrapezoid.Add(projected0);
      else ptsTrapezoid.Add(edgeB.From);
      if(projected1.DistanceTo(edgeB.ClosestPoint(projected1, true)) < tolerance &&
        projected1.X != double.MaxValue) ptsTrapezoid.Add(projected1);
      else ptsTrapezoid.Add(edgeB.To);
      ptsTrapezoid.Add(ptsTrapezoid[0]);
      trapezoidArea = CalculateTriangleArea(ptsTrapezoid[0], ptsTrapezoid[1], ptsTrapezoid[2]);
      trapezoidArea += CalculateTriangleArea(ptsTrapezoid[0], ptsTrapezoid[3], ptsTrapezoid[2]);

      trapezoid = new Polyline(ptsTrapezoid);
    }
    public Polyline getTriangle1(){
      return triangle1;
    }
    public Polyline getTriangle2(){
      return triangle2;
    }
    public Polyline getTrapezoid(){
      return trapezoid;
    }
    public double getTotalArea(){
      return triangle1Area + triangle2Area + trapezoidArea;
    }

    /// <summary>
    ///
    /// </summary>
    /// <param name="polyline"></param>
    /// <param name="singlePartArea"></param>
    /// <returns></returns>
    public List<Cut> getCuts(Polyline polyline, double singlePartArea){
      List<Cut> cuts = new List<Cut>();
      List<Line> segments = polyline.GetSegments().ToList();
      int indexOfEdgeA = 0;
      int indexOfEdgeB = 0;
      for(int i = 0; i < segments.Count;i++){
        if(edgeA.PointAt(0.5).DistanceTo(segments[i].PointAt(0.5)) < 0.001){
          indexOfEdgeA = i;
        }
        else if(edgeB.PointAt(0.5).DistanceTo(segments[i].PointAt(0.5)) < 0.001){
          indexOfEdgeB = i;
        }
      }

      int segmentsCovered = indexOfEdgeB - indexOfEdgeA + 1;// number of segments covered by a LineRing starting with edgeA and ending with edgeB (including)
      // Polygon's exterior ring is equal to [edgeA + segmentsBetweenEdgePair + edgeB + segmentsOutsideEdgePair]
      int segmentCountBetweenEdgePair = segmentsCovered - 2;
      int segmentCountOutsideEdgePair = segments.Count - segmentsCovered;
      // if edges are not connected directly, polygon has extra area adjacent to them
      Polyline polylineOutside1 = new Polyline();
      Polyline polylineOutside2 = new Polyline();

      if (segmentCountBetweenEdgePair > 1) {
        // calculate extra area bounded by segmentsBetweenEdgePair
        for(int i = 0; i < segmentCountBetweenEdgePair + 1; i++){
          int ptIdx = indexOfEdgeA + 1 + i;
          if(ptIdx >= segments.Count) ptIdx -= segments.Count;
          polylineOutside1.Add(polyline[ptIdx]);
        }
        polylineOutside1.Add(polylineOutside1[0]);
      }
      if (segmentCountOutsideEdgePair > 1) {
        // calculate extra area bounded by segmentCountOutsideEdgePair
        for(int i = 0; i < segmentCountOutsideEdgePair + 1; i++){
          int ptIdx = indexOfEdgeB + 1 + i;
          if(ptIdx >= segments.Count) ptIdx -= segments.Count;
          polylineOutside2.Add(polyline[ptIdx]);

        }
        polylineOutside2.Add(polylineOutside2[0]);
      }
      double areaOutside1 = 0, areaOutside2 = 0;
      if(polylineOutside1 != null && polylineOutside1.IsValid && polylineOutside1.Length > 0.01){
        AreaMassProperties amp = AreaMassProperties.Compute(polylineOutside1.ToNurbsCurve());
        if(amp != null) areaOutside1 = amp.Area;
      }
      if(polylineOutside2 != null && polylineOutside2.IsValid && polylineOutside2.Length > 0.01){
        AreaMassProperties amp = AreaMassProperties.Compute(polylineOutside2.ToNurbsCurve());
        if(amp != null) areaOutside2 = amp.Area;
      }

      // check first direction (areaOutside1 + T1 + Trapezoid + T2)
      if(areaOutside1 <= singlePartArea){

        Line lineOfCut = new Line();
        if(areaOutside1 + triangle1Area > singlePartArea){
          double areaToCutAwayInTriangle = singlePartArea - areaOutside1;
          double fraction = areaToCutAwayInTriangle / triangle1Area;
          if(triangle1 != null){
            Point3d projected0 = triangle1[1];
            Line edgeWithPointOfCut = (edgeA.ClosestPoint(projected0, true).DistanceTo(projected0) < 0.000001) ? new Line(edgeA.To, projected0) : new Line(edgeB.From, projected0);
            Point3d pointOfCut = edgeWithPointOfCut.PointAt(fraction);
            lineOfCut = (edgeA.ClosestPoint(pointOfCut, true).DistanceTo(pointOfCut) < 0.000001) ? new Line(edgeB.From, pointOfCut) : new Line(pointOfCut, edgeA.To);
          }

        }else if(areaOutside1 + triangle1Area + trapezoidArea >= singlePartArea){

          Line trapezoidOnEdgeA = trapezoid.SegmentAt(0);
          Line trapezoidOnEdgeB = trapezoid.SegmentAt(2);
          trapezoidOnEdgeA.Flip();
          double areaToCutAway = singlePartArea - (areaOutside1 + triangle1Area);
          double fraction = areaToCutAway / trapezoidArea;

          double ia, ib;
          if(Rhino.Geometry.Intersect.Intersection.LineLine(trapezoidOnEdgeA, trapezoidOnEdgeB, out ia, out ib))
          {

            Point3d intersectionPoint = trapezoidOnEdgeA.PointAt(ia);
            double wholeDistance = intersectionPoint.DistanceTo(trapezoidOnEdgeA.From);
            double distTo = intersectionPoint.DistanceTo(trapezoidOnEdgeA.To);
            bool flip = true;
            if(distTo > wholeDistance){ wholeDistance = distTo; flip = false; fraction = 1 - fraction;}
            fraction = splitFractionTrapezoid(trapezoidOnEdgeA.Length, wholeDistance, trapezoidOnEdgeA.UnitTangent, fraction);
            if(!flip) fraction = 1 - fraction;
          }

          Point3d pointOfCutOnEdgeA = trapezoidOnEdgeA.PointAt(fraction);
          Point3d pointOfCutOnEdgeB = trapezoidOnEdgeB.PointAt(fraction);
          lineOfCut = new Line(pointOfCutOnEdgeB, pointOfCutOnEdgeA);


        }else if(areaOutside1 + getTotalArea() >= singlePartArea){

          double areaToCutAwayInTriangle = singlePartArea - (areaOutside1 + triangle1Area + trapezoidArea);
          double fraction = areaToCutAwayInTriangle / triangle2Area;
          if(triangle1 != null){
            Point3d projected1 = triangle2[1];
            Line edgeWithPointOfCut = (edgeA.ClosestPoint(projected1, true).DistanceTo(projected1) < 0.000001) ? new Line(projected1, edgeA.From) : new Line(projected1, edgeB.To);
            Point3d pointOfCut = edgeWithPointOfCut.PointAt(fraction);
            lineOfCut = (edgeA.ClosestPoint(pointOfCut, true).DistanceTo(pointOfCut) < 0.000001) ? new Line(edgeB.To, pointOfCut) : new Line(pointOfCut, edgeA.From);
          }
        }

        Rhino.Geometry.Intersect.CurveIntersections ci = Rhino.Geometry.Intersect.Intersection.CurveLine(polyline.ToNurbsCurve(), lineOfCut, 0.001, 0.001);
        int intCount = 0;
        foreach(Rhino.Geometry.Intersect.IntersectionEvent ie in ci) if(ie.IsPoint)intCount++;
        if(lineOfCut != null && intCount <= 2){

          PolylineCurve polyCurve = polyline.ToPolylineCurve();
          double t0, t1;
          polyCurve.ClosestPoint(lineOfCut.To, out t0);
          polyCurve.ClosestPoint(lineOfCut.From, out t1);

          if(t0 != t1){

            Curve cutAway = polyCurve.Trim(new Interval(t0, t1));
            if(cutAway != null){
              Polyline plCutAway = cutAway.ToPolyline(0.000001, 0.000001, 0.001, 1000000).ToPolyline();
              plCutAway.Add(plCutAway[0]);
              plCutAway.ReduceSegments(0.000001);

              Curve cutRemain = polyCurve.Trim(new Interval(t1, t0));
              Polyline plCutRemain = cutRemain.ToPolyline(0.000001, 0.000001, 0.001, 1000000).ToPolyline();
              plCutRemain.Add(plCutRemain[0]);
              plCutRemain.ReduceSegments(0.000001);
              cuts.Add(new Cut(lineOfCut.Length, plCutAway, plCutRemain));
            }
          }
        }
      }

      // check first direction (areaOutside1 + T1 + Trapezoid + T2)
      if(areaOutside2 <= singlePartArea){

        Line lineOfCut = new Line();
        if(areaOutside2 + triangle2Area > singlePartArea){
          double areaToCutAwayInTriangle = singlePartArea - areaOutside2;

          double fraction = areaToCutAwayInTriangle / triangle2Area;
          if(triangle2 != null){
            Point3d projected1 = triangle2[1];
            Line edgeWithPointOfCut = (edgeA.ClosestPoint(projected1, true).DistanceTo(projected1) < 0.000001) ? new Line(edgeA.From, projected1) : new Line(edgeB.To, projected1);
            Point3d pointOfCut = edgeWithPointOfCut.PointAt(fraction);
            lineOfCut = (edgeA.ClosestPoint(pointOfCut, true).DistanceTo(pointOfCut) < 0.000001) ? new Line(pointOfCut, edgeB.To) : new Line(edgeA.From, pointOfCut);
          }


        }else if(areaOutside2 + triangle2Area + trapezoidArea >= singlePartArea){

          Line trapezoidOnEdgeA = trapezoid.SegmentAt(0);
          Line trapezoidOnEdgeB = trapezoid.SegmentAt(2);
          trapezoidOnEdgeB.Flip();

          double areaToCutAway = singlePartArea - (areaOutside2 + triangle2Area);
          double fraction = areaToCutAway / trapezoidArea;
          double ia, ib;
          if(Rhino.Geometry.Intersect.Intersection.LineLine(trapezoidOnEdgeA, trapezoidOnEdgeB, out ia, out ib))
          {

            Point3d intersectionPoint = trapezoidOnEdgeA.PointAt(ia);
            double wholeDistance = intersectionPoint.DistanceTo(trapezoidOnEdgeA.From);
            double distTo = intersectionPoint.DistanceTo(trapezoidOnEdgeA.To);
            bool flip = true;
            if(distTo > wholeDistance){ wholeDistance = distTo; flip = false; fraction = 1 - fraction;}
            fraction = splitFractionTrapezoid(trapezoidOnEdgeA.Length, wholeDistance, trapezoidOnEdgeA.UnitTangent, fraction);
            if(!flip) fraction = 1 - fraction;
          }

          Point3d pointOfCutOnEdgeA = trapezoidOnEdgeA.PointAt(fraction);
          Point3d pointOfCutOnEdgeB = trapezoidOnEdgeB.PointAt(fraction);
          lineOfCut = new Line(pointOfCutOnEdgeA, pointOfCutOnEdgeB);

        }else if(areaOutside2 + getTotalArea() >= singlePartArea){

          double areaToCutAwayInTriangle = singlePartArea - (areaOutside2 + triangle2Area + trapezoidArea);
          double fraction = areaToCutAwayInTriangle / triangle1Area;
          if(triangle1 != null){
            Point3d projected0 = triangle1[1];
            Line edgeWithPointOfCut = (edgeA.ClosestPoint(projected0, true).DistanceTo(projected0) < 0.000001) ? new Line(projected0, edgeA.To) : new Line(projected0, edgeB.From);
            Point3d pointOfCut = edgeWithPointOfCut.PointAt(fraction);
            lineOfCut = (edgeA.ClosestPoint(pointOfCut, true).DistanceTo(pointOfCut) < 0.000001) ? new Line(pointOfCut, edgeB.From) : new Line(edgeA.To, pointOfCut);
          }
        }
        Rhino.Geometry.Intersect.CurveIntersections ci = Rhino.Geometry.Intersect.Intersection.CurveLine(polyline.ToNurbsCurve(), lineOfCut, 0.001, 0.001);
        int intCount = 0;
        foreach(Rhino.Geometry.Intersect.IntersectionEvent ie in ci) if(ie.IsPoint)intCount++;
        if(lineOfCut != null && intCount <= 2){
          PolylineCurve polyCurve = polyline.ToPolylineCurve();
          double t0, t1;
          polyCurve.ClosestPoint(lineOfCut.To, out t0);
          polyCurve.ClosestPoint(lineOfCut.From, out t1);

          if(t0 != t1){

            Curve cutAway = polyCurve.Trim(new Interval(t0, t1));
            if(cutAway != null){
              Polyline plCutAway = cutAway.ToPolyline(0.000001, 0.000001, 0.001, 1000000).ToPolyline();
              plCutAway.Add(plCutAway[0]);
              plCutAway.ReduceSegments(0.000001);
              Curve cutRemain = polyCurve.Trim(new Interval(t1, t0));
              Polyline plCutRemain = cutRemain.ToPolyline(0.000001, 0.000001, 0.001, 1000000).ToPolyline();
              plCutRemain.Add(plCutRemain[0]);
              plCutRemain.ReduceSegments(0.000001);
              cuts.Add(new Cut(lineOfCut.Length, plCutAway, plCutRemain));
            }
          }
        }
      }


      return cuts;


    }

    public double splitFractionTrapezoid(double distance, double wholeDistance, Vector3d dir, double fraction){
      dir.Unitize();
      double remainingDistance = wholeDistance - distance;
      Vector3d rotateVec = dir * remainingDistance;
      rotateVec.Rotate(Math.Acos(remainingDistance / wholeDistance), Vector3d.ZAxis);
      double projectedDistance = Math.Abs(Vector3d.Multiply(rotateVec, dir));
      double ankathete = wholeDistance - (fraction * (wholeDistance - projectedDistance));
      double gegenkathete = Math.Sqrt(Math.Pow(wholeDistance / 2.0, 2) - Math.Pow((wholeDistance / 2.0 - ankathete), 2));
      double hypothenuse = Math.Sqrt(Math.Pow(ankathete, 2) + Math.Pow((gegenkathete), 2));

      return (wholeDistance - hypothenuse) / distance;

    }
    private double CalculateTriangleArea(Point3d pt0, Point3d pt1, Point3d pt2){
      return Math.Abs(Vector3d.CrossProduct(new Vector3d(pt0 - pt2), new Vector3d(pt1 - pt2)).Length / 2);

    }
  }
# ---------- end equalareagreedy ----------
offset_2 = OffsetCurve(Curve=equalareagreedy.A, Distance=Slider(0, range=-3..0), Corners=1)
hideshow_15 = HideShowObjectPreview(Visible=toggle, AllObjects_Object=[custom_preview_lineweights_8, custom_preview_lineweights_9])

landsscape_tree = Panel(multiplication_6)

# ----
# Calculated with final time to target multiplier and the difficulties of multiplier (Biodiversity Net-Gain 4. 2023)
multiplication_7 = Multiplication(A=landsscape_tree, B=value_list_12, C=value_list_13)

habitat_unit_2 = Panel(multiplication_7)

# ----
# YEAR ESTIMATION
# CREATED
function = Panel(python_8.a)

panel_9 = Panel([python.Effects_human, human_effects_2, human_effects, function])

year = Panel([python_7.a, python_6.b, python_2.a])

cset_11 = CreateSet(List=panel_9)  # -> Set, Map
panel_10 = Panel(cset_11.Set)
mindex_6 = MemberIndex(Set=panel_9, Member=cset_11.Set)  # -> Index, Count

equalareagreedy_2 = CSharpScript(pl=equalareagreedy.A)  # -> out, A; inputs pl: Polyline, n: Int32; same code as equalareagreedy
trim_2 = TrimWithRegion(Curve=equalareagreedy_2.A, Region=area_plot_neighborhoof)  # -> Inside, Outside

equalareagreedy_3 = CSharpScript(pl=offset_2, n=layer_2)  # -> out, A; inputs pl: Polyline, n: Int32; same code as equalareagreedy
equalareagreedy_4 = CSharpScript(pl=equalareagreedy_3.A, n=layer_3)  # -> out, A; inputs pl: Polyline, n: Int32; same code as equalareagreedy

trim_3 = TrimWithRegion(Curve=equalareagreedy_4.A, Region=area_plot_neighborhoof)  # -> Inside, Outside
boundary_3 = BoundarySurfaces(Edges=trim_3.Inside)

area_6 = Area(Geometry=boundary_3)  # -> Area, Centroid
ma_3 = MassAddition(Input=flatten(area_6.Area))  # -> Result, PartialResults
panel_11 = Panel(ma_3.Result)

area_7 = Area(Geometry=boundary_2)  # -> Area, Centroid
subtraction = Subtraction(A=area_7.Area, B=panel_11)

equalareagreedy_5 = CSharpScript(pl=equalareagreedy_4.A)  # -> out, A; inputs pl: Polyline, n: Int32; same code as equalareagreedy
equalareagreedy_6 = CSharpScript(pl=equalareagreedy_5.A, n=number_slider_2)  # -> out, A; inputs pl: Polyline, n: Int32; same code as equalareagreedy

width_path = Slider(5, range=0..10)
custom_preview_lineweights_4 = CustomPreviewLineweights(
    Geometry=[trim_2.Inside, equalareagreedy_3.A, equalareagreedy_4.A],
    Shader=ColourSwatch(SwatchColor=RGB(171, 175, 162)),
    Thickness=width_path,
    Absolute=False)

item_4 = ListItem(List=equalareagreedy_6.A, Index=number_slider, Wrap=True)

trim_4 = TrimWithRegions(Curve=equalareagreedy_6.A, Regions=item_4)  # -> Inside, Outside
equalareagreedy_7 = CSharpScript(pl=trim_4.Outside, n=number_slider_3)  # -> out, A; inputs pl: Polyline, n: Int32; same code as equalareagreedy
cull_i = CullIndex(List=equalareagreedy_7.A, Indices=number_slider_4, Wrap=True)
trim_5 = TrimWithRegions(Curve=equalareagreedy_7.A, Regions=cull_i)  # -> Inside, Outside

offset_3 = OffsetCurve(Curve=item_4, Distance=Slider(0, range=-5..0), Corners=1)

equalareagreedy_8 = CSharpScript(pl=[trim_5.Inside, cull_i], n=number_slider_7)  # -> out, A; inputs pl: Polyline, n: Int32; same code as equalareagreedy
item_5 = ListItem(List=equalareagreedy_8.A, Index=Slider(32, range=0..100), Wrap=True)
trim_6 = TrimWithRegions(Curve=equalareagreedy_8.A, Regions=item_5)  # -> Inside, Outside

# ---- group: APARTEMENT
equalareagreedy_9 = CSharpScript(pl=offset_3, n=number_slider_8)  # -> out, A; inputs pl: Polyline, n: Int32; same code as equalareagreedy

# ----
equalareagreedy_10 = CSharpScript(pl=equalareagreedy_7.A, n=Slider(4, range=0..10))  # -> out, A; inputs pl: Polyline, n: Int32; same code as equalareagreedy
item_6 = ListItem(List=equalareagreedy_10.A, Index=Slider(4, range=0..10), Wrap=True)
trim_7 = TrimWithRegion(Curve=equalareagreedy_10.A, Region=item_6)  # -> Inside, Outside
boundary_4 = BoundarySurfaces(Edges=item_6)
equalareagreedy_11 = CSharpScript(pl=trim_7.Outside, n=Slider(2, range=0..10))  # -> out, A; inputs pl: Polyline, n: Int32; same code as equalareagreedy
item_7 = ListItem(List=equalareagreedy_11.A, Index=Slider(4, range=0..10), Wrap=True)

# ---- group: BAREGROUND
boundary_5 = BoundarySurfaces(Edges=trim_7.Outside)
custom_preview_lineweights_5 = CustomPreviewLineweights(Geometry=boundary_5, Shader=ColourSwatch(SwatchColor=RGB(160, 183, 37)), Absolute=False)

# ----
number_slider_9 = Slider(19, range=0..50)
area_8 = Area(Geometry=equalareagreedy_3.A, UseTasks=True)  # -> Area, Centroid
swatch = ColourSwatch(SwatchColor=RGB(0, 0, 0))
screentext_4 = ScreenOrientedText(
    Text=area_8.Area,
    Justification=7,
    Location=area_8.Centroid,
    SizeFactor=number_slider_9,
    Color=swatch,
    Depth=0,
    Absolute=False)

area_9 = Area(Geometry=area_plot_neighborhoof)  # -> Area, Centroid
screentext_5 = ScreenOrientedText(
    Text=area_9.Area,
    Justification=7,
    Location=area_9.Centroid,
    SizeFactor=number_slider_9,
    Color=swatch,
    Depth=0,
    Absolute=False)

# ----
# Input your site geometry, location
# and information here
# 1
panel_12 = Panel(area_9.Area)

multiplication_8 = Multiplication(A=panel_12, B=value_list, C=value_list_3, D=value_list_2)
division_5 = Division(A=multiplication_8, B=10000)

# ----
# AREA SIZE TAG
panel_13 = Panel("(AFTER)")
panel_14 = Panel("""ENVIRONMENTAL
EFFECT""")
panel_15 = Panel("""ENVIRONMENTAL 
EFFECT""")
panel_16 = Panel("""POLLINATORS
INVITED """)
chart = CreateChart(Data=mindex_5.Count, Names=panel_7, Title=panel_14, SubTitle=panel_13, ChartType=1)
chart_2 = CreateChart(Data=mindex.Count, Names=panel_2, Title=panel_16, SubTitle="(BEFORE)", ChartType=0)
chart_3 = CreateChart(Data=mindex_3.Count, Names=panel_4, Title=panel_15, SubTitle="(BEFORE)", ChartType=1)
chart_4 = CreateChart(Data=mindex_2.Count, Names=panel_3, Title="EFFECTS", SubTitle="(BEFORE)", ChartType=1)
stack = CreateStack(UIElements=[chart_3, chart], Horizontal=True)
addition = Addition(A=division_5, B=habitat_unit)
crv_2 = Curve(area_plot_neighborhoof)
crv_3 = Curve(<curve referenced from the Rhino model>)
boundary_6 = BoundarySurfaces(Edges=crv_3)

# ----
# BASE
panel_17 = Panel(addition)

boundary_7 = BoundarySurfaces(Edges=crv_2)
divide = DivideDomain²(Domain=boundary_7, UCount=Slider(43, range=0..100), VCount=Slider(40, range=0..100))  # -> flatten(Segments)
subsrf = Isotrim(Surface=flatten(boundary_7), Domain=divide)  # -> flatten(Surface)
debrep_2 = DeconstructBrep(Brep=subsrf)  # -> Faces, Edges, Vertices
area_10 = Area(Geometry=debrep_2.Faces)  # -> Area, Centroid

boundary_8 = BoundarySurfaces(Edges=crv_2)
divide_2 = DivideDomain²(Domain=boundary_8, UCount=Slider(31, range=0..100), VCount=Slider(33, range=0..100))  # -> flatten(Segments)
subsrf_2 = Isotrim(Surface=flatten(boundary_8), Domain=divide_2)  # -> flatten(Surface)
debrep_3 = DeconstructBrep(Brep=subsrf_2)  # -> Faces, Edges, Vertices
area_11 = Area(Geometry=debrep_3.Faces)  # -> Area, Centroid

number_slider_10 = Slider(9, range=0..100)
geo = Geometry(boundary_5)
mshadow = MeshShadow(Mesh=geo, Light=Vector(0, 0, -1), Plane=PlaneXY(0, 0, 0))
number_slider_11 = Slider(70, range=0..100)
ivist = IsoVist(Plane=area_10.Centroid, Count=number_slider_10, Radius=number_slider_11, Obstacles=flatten(mshadow))  # -> Points, Distance, Index
ma_4 = MassAddition(Input=ivist.Distance)  # -> reverse(Result), PartialResults
division_6 = Division(A=ma_4.Result, B=number_slider_10)  # -> reverse(Result)
remap = RemapNumbers(Value=division_6, Source=number_slider_11, Target=Domain(0, 1))  # -> Mapped, Clipped

area_12 = Area(Geometry=[equalareagreedy.A, equalareagreedy_3.A])  # -> Area, Centroid
screentext_6 = ScreenOrientedText(
    Text=area_12.Area,
    Justification=7,
    Location=area_12.Centroid,
    SizeFactor=Slider(15, range=0..100),
    Depth=0,
    Absolute=False)
item_8 = ListItem(List=equalareagreedy_9.A, Index=Slider(10, range=0..10), Wrap=True)
trim_8 = TrimWithRegion(Curve=equalareagreedy_9.A, Region=item_8)  # -> Inside, Outside
boundary_9 = BoundarySurfaces(Edges=item_8)
gradient = Gradient(
    LowerLimit=0,
    UpperLimit=1,
    Parameter=remap.Mapped,
    stops=[0: RGB(255, 255, 192), 0.168: RGB(255, 255, 128), 0.512: RGB(144, 238, 144), 0.802: RGB(64, 224, 208), 1: RGB(0, 191, 255)])

item_9 = ListItem(List=boundary_9, Index=Slider(17, range=0..100), Wrap=True)

area_13 = Area(Geometry=item_9)  # -> Area, Centroid
ma_5 = MassAddition(Input=flatten(area_13.Area))  # -> Result, PartialResults

# ---- group: type 2
Z_2 = UnitZ(Factor=height)
extr_2 = Extrude(Base=trim_8.Outside, Direction=Z_2)

# ---- group: type 1
Z_3 = UnitZ(Factor=height_3)
extr_3 = Extrude(Base=item_8, Direction=Z_3)

# ----
brep = Brep(extr_3)
brep_2 = Brep(extr_2)

# ----
# BUILDING FACADE
swatch_2 = ColourSwatch(SwatchColor=RGB(171, 183, 182))
custom_preview_lineweights_6 = CustomPreviewLineweights(Geometry=[brep, brep_2], Shader=swatch_2, Absolute=False)

crv_4 = Curve(trim_8.Outside)
boundary_10 = BoundarySurfaces(Edges=item_8)
boundary_11 = BoundarySurfaces(Edges=trim_8.Outside)
offset_4 = OffsetCurve(Curve=crv_4, Distance=Slider(0, range=0..10), Corners=1)

move = Move(Geometry=boundary_10, Motion=Z_3)  # -> Geometry, Transform
move_2 = Move(Geometry=boundary_11, Motion=Z_2)  # -> Geometry, Transform

custom_preview_lineweights_7 = CustomPreviewLineweights(Geometry=[move_2.Geometry, move.Geometry], Shader=ColourSwatch(SwatchColor=RGB(171, 183, 182)), Absolute=False)

boundary_12 = BoundarySurfaces(Edges=trim_8.Outside)
boundary_13 = BoundarySurfaces(Edges=item_8)
Z_4 = UnitZ(Factor=height)
Z_5 = UnitZ(Factor=height_3)
move_3 = Move(Geometry=boundary_13, Motion=Z_5)  # -> Geometry, Transform
move_4 = Move(Geometry=boundary_12, Motion=Z_4)  # -> Geometry, Transform

equalareagreedy_12 = CSharpScript(pl=move_3.Geometry, n=number_slider_5)  # -> out, A; inputs pl: Polyline, n: Int32; same code as equalareagreedy
equalareagreedy_13 = CSharpScript(pl=move_4.Geometry, n=number_slider_5)  # -> out, A; inputs pl: Polyline, n: Int32; same code as equalareagreedy
item_10 = ListItem(List=equalareagreedy_12.A, Index=Slider(5, range=0..10), Wrap=True)
item_11 = ListItem(List=equalareagreedy_13.A, Index=Slider(5, range=0..10), Wrap=True)
trim_9 = TrimWithRegion(Curve=equalareagreedy_13.A, Region=item_11)  # -> Inside, Outside
trim_10 = TrimWithRegion(Curve=equalareagreedy_12.A, Region=item_10)  # -> Inside, Outside

# ----
# INTENSIVE GREENROOF
boundary_14 = BoundarySurfaces(Edges=[trim_9.Outside, trim_10.Outside])
custom_preview_lineweights_8 = CustomPreviewLineweights(Geometry=boundary_14, Shader=ColourSwatch(SwatchColor=RGB(179, 214, 149)), Absolute=False)

# ----
# BIODIVERSE GREEN ROOF
boundary_15 = BoundarySurfaces(Edges=[item_11, item_10])
custom_preview_lineweights_9 = CustomPreviewLineweights(Geometry=boundary_15, Shader=ColourSwatch(SwatchColor=RGB(74, 90, 0)), Absolute=False)

area_14 = Area(Geometry=boundary_15)  # -> Area, Centroid
listdexs = ListIndices(List=flatten(area_14.Centroid))
mindex_7 = MemberIndex(Set=listdexs, Member=listdexs)  # -> Index, Count
ma_6 = MassAddition(Input=mindex_7.Count)  # -> Result, PartialResults
panel_18 = Panel(ma_6.Result)
multiplication_9 = Multiplication(A=how_many_trees_3, B=panel_18)

area_15 = Area(Geometry=boundary_15)  # -> flatten(Area), Centroid
ma_7 = MassAddition(Input=area_15.Area)  # -> Result, PartialResults
item_12 = ListItem(List=area_15.Area, Index=Slider(0, range=0..100), Wrap=True)

panel_19 = Panel(ma_7.Result)
panel_20 = Panel(item_12)

multiplication_10 = Multiplication(A=panel_19, B=value_list_15, C=value_list_17, D=value_list_16)
division_7 = Division(A=multiplication_10, B=10000)

area_16 = Area(Geometry=boundary_14)  # -> flatten(Area), Centroid
panel_21 = Panel(area_16.Area)
ma_8 = MassAddition(Input=panel_21)  # -> Result, PartialResults
item_13 = ListItem(List=panel_21, Index=Slider(0, range=0..100), Wrap=True)

total = Panel(ma_8.Result)
area_gf = Panel(item_13)

multiplication_11 = Multiplication(A=total, B=value_list_18, C=value_list_20, D=value_list_19)
division_8 = Division(A=multiplication_11, B=10000)

boundary_16 = BoundarySurfaces(Edges=trim_8.Outside)
area_17 = Area(Geometry=boundary_9)  # -> flatten(Area), Centroid
area_18 = Area(Geometry=boundary_16)  # -> flatten(Area), Centroid

area_19 = Panel(area_18.Area)
area_20 = Panel(area_17.Area)

# ----
# CALCULATOR
mm = MassMultiplication(Input=[area_19, area_20])  # -> Result, PartialResults

building_area = Panel(mm.Result)

# ----
# TRADING SUMMARY HABITATS
# HABITAT: TREES (GREEN ROOF)
# TREES (LANDSCAPE)
# GREEN WALL
# GREEN ROOF
area_created = Panel(building_area)

subtraction_2 = Subtraction(A=panel_11, B=building_area)

debrep_4 = DeconstructBrep(Brep=extr_2)  # -> Faces, Edges, Vertices
item_14 = ListItem(List=debrep_4.Faces, Index=building_type_2, Wrap=True)
equalareagreedy_14 = CSharpScript(pl=item_14, n=Slider(3, range=0..10))  # -> out, A; inputs pl: Polyline, n: Int32; same code as equalareagreedy
number_slider_12 = Slider(2, range=0..10)
Y = UnitY(Factor=Slider(-0.5, range=-1..-0.5))
boundary_17 = BoundarySurfaces(Edges=equalareagreedy_14.A)
extr_4 = Extrude(Base=boundary_17, Direction=Y)
previewlw = CustomPreviewLineweights(Geometry=extr_4, Shader=ColourSwatch(SwatchColor=RGB(72, 136, 43)), Absolute=False)

debrep_5 = DeconstructBrep(Brep=extr_3)  # -> Faces, Edges, Vertices
item_15 = ListItem(List=debrep_5.Faces, Index=building_type_1, Wrap=True)
equalareagreedy_15 = CSharpScript(pl=item_15, n=Slider(3, range=0..10))  # -> out, A; inputs pl: Polyline, n: Int32; same code as equalareagreedy
number_slider_13 = Slider(2, range=0..10)
Y_2 = UnitY(Factor=Slider(0.2, range=-1..1))
boundary_18 = BoundarySurfaces(Edges=equalareagreedy_15.A)
extr_5 = Extrude(Base=boundary_18, Direction=Y_2)
previewlw_2 = CustomPreviewLineweights(Geometry=extr_5, Shader=ColourSwatch(SwatchColor=RGB(72, 136, 43)), Absolute=False)

multiplication_12 = Multiplication(A=building_area, B=value_list_28, C=value_list_3, D=value_list_2)
division_9 = Division(A=multiplication_12, B=10000)

addition_2 = Addition(A=division_2, B=division_9)

area_21 = Area(Geometry=boundary_9, UseTasks=True)  # -> Area, Centroid
screentext_7 = ScreenOrientedText(
    Text=area_21.Area,
    Justification=7,
    Location=area_21.Centroid,
    SizeFactor=Slider(10, range=0..10),
    Color=ColourSwatch(SwatchColor=RGB(0, 0, 0)),
    Depth=0,
    Absolute=False)

amount_tree = Panel(multiplication_9)

multiplication_13 = Multiplication(A=amount_tree, B=how_many_trees_2)
multiplication_14 = Multiplication(A=multiplication_13, B=value_list_34, C=value_list_33)
division_10 = Division(A=multiplication_14, B=10000)

multiplication_15 = Multiplication(A=amount_tree, B=canopy_wide_2)
multiplication_16 = Multiplication(A=multiplication_15, B=value_list_34, C=value_list_33)
division_11 = Division(A=multiplication_16, B=10000)

habitat_unit_3 = Panel(division_11)

# ----
# INDIVIDUAL TREES
panel_22 = Panel(habitat_unit_3)

panel_23 = Panel("""HABITAT TARGET
HABITAT CREATION""")
launchwin = LaunchWindow(
    Show=toggle_2,
    Name="Control Window",
    Width=370,
    Height=Slider(250, range=0..1000),
    ChildStatus=0,
    EnableHorizScroll=False)

panel_24 = Panel("""POLLINATORS 
INVITED """)
chart_5 = CreateChart(Data=mindex_6.Count, Names=panel_10, Title="EFFECTS", SubTitle="(AFTER)", ChartType=1)
chart_6 = CreateChart(Data=mindex_4.Count, Names=panel_8, Title=panel_24, SubTitle="(AFTER)", ChartType=0)

stack_2 = CreateStack(UIElements=[chart_2, chart_6], Horizontal=True)
stack_3 = CreateStack(UIElements=[chart_4, chart_5], Horizontal=True)
boundary_19 = BoundarySurfaces(Edges=item_8)
preview = CustomPreview(Geometry=subsrf, Material=flatten(gradient))
area_22 = Area(Geometry=boundary_17)  # -> flatten(Area), Centroid
area_23 = Area(Geometry=boundary_18)  # -> flatten(Area), Centroid
ma_9 = MassAddition(Input=area_22.Area)  # -> Result, PartialResults
ma_10 = MassAddition(Input=area_23.Area)  # -> Result, PartialResults

panel_25 = Panel(ma_9.Result)
panel_26 = Panel(ma_10.Result)
addition_3 = Addition(A=panel_25, B=panel_26)

python_9 = GhPythonScript(x=show_5, y=addition_3)  # -> out, a
# ---------- python_9: Python ----------
__author__ = "LENOVO-PC"
__version__ = "2023.05.16"

import rhinoscriptsyntax as rs
if x == False:
    a = "0"
elif x == True:
    a = y

print a
# ---------- end python_9 ----------

area_24 = Panel(python_9.a)

multiplication_17 = Multiplication(Area=area_24, Habitat=value_list_21, Condition=python_6.a, Strategy=value_list_23)
division_12 = Division(A=multiplication_17, B=10000)

habitat_unit_4 = Panel(division_12)

addition_4 = Addition(A=division_8, B=division_7, C=habitat_unit_4)

# ----
# BUILDING
panel_27 = Panel(addition_4)

area_25 = Area(Geometry=boundary_5)  # -> Area, Centroid

number_slider_14 = Slider(4, range=0..10)

swatch_3 = ColourSwatch(SwatchColor=RGB(0, 0, 24))
custom_preview_lineweights_10 = CustomPreviewLineweights(Geometry=boundary_16, Shader=swatch_3, Thickness=number_slider_14, Absolute=False)

custom_preview_lineweights_11 = CustomPreviewLineweights(Geometry=boundary_19, Shader=swatch_3, Thickness=number_slider_14, Absolute=False)

# ----
# LANDSCAPE
boundary_20 = BoundarySurfaces(Edges=item_7)
boundary_21 = BoundarySurfaces(Edges=[trim_6.Outside, item_6])
trim_11 = TrimWithRegion(Curve=boundary_21, Region=boundary_20)  # -> Inside, Outside

area_26 = Area(Geometry=boundary_21)  # -> Area, Centroid
ma_11 = MassAddition(Input=flatten(area_26.Area))  # -> Result, PartialResults

multiplication_18 = Multiplication(A=area_5, B=value_list_4, C=boundary_20, D=value_list_6)
division_13 = Division(A=multiplication_18, B=10000)

area_27 = Area(Geometry=boundary_20)  # -> Area, Centroid
ma_12 = MassAddition(Input=flatten(area_27.Area))  # -> flatten(Result), PartialResults
subtraction_3 = Subtraction(A=area_25.Area, B=area_27.Area)  # -> flatten(Result)
ma_13 = MassAddition(Input=subtraction_3)  # -> flatten(Result), flatten(PartialResults)

area_28 = Panel(ma_12.Result)

panel_28 = Panel(ma_13.Result)
item_16 = ListItem(List=panel_28, Index=Slider(0, range=0..100), Wrap=True)

area_29 = Panel(item_16)

multiplication_19 = Multiplication(A=area_28, B=value_list_8, C=value_list_7)
multiplication_20 = Multiplication(A=area_29, B=value_list_11, C=value_list_10)
division_14 = Division(A=multiplication_19, B=10000)
division_15 = Division(A=multiplication_20, B=10000)

habitat_unit_garden = Panel(division_15)

habitat_unit_5 = Panel(division_14)

custom_preview_lineweights_12 = CustomPreviewLineweights(Geometry=boundary_20, Shader=ColourSwatch(SwatchColor=RGB(0, 109, 29)), Thickness=boundary_20, Absolute=False)

custom_preview_lineweights_13 = CustomPreviewLineweights(Geometry=[trim_11.Outside, boundary_4], Shader=ColourSwatch(SwatchColor=RGB(212, 232, 155)), Absolute=False)

number_slider_15 = Slider(8, range=0..100)
geo_2 = Geometry(boundary_20)
mshadow_2 = MeshShadow(Mesh=[geo_2, boundary_6], Light=Vector(0, 0, -1), Plane=PlaneXY(0, 0, 0))
number_slider_16 = Slider(55, range=0..100)
ivist_2 = IsoVist(Plane=area_11.Centroid, Count=number_slider_15, Radius=number_slider_16, Obstacles=flatten(mshadow_2))  # -> Points, Distance, Index
ma_14 = MassAddition(Input=ivist_2.Distance)  # -> reverse(Result), PartialResults
division_16 = Division(A=ma_14.Result, B=number_slider_15)  # -> reverse(Result)
remap_2 = RemapNumbers(Value=division_16, Source=number_slider_16, Target=Domain(0, 1))  # -> Mapped, Clipped

# ----
# public spaces
gradient_2 = Gradient(
    LowerLimit=0,
    UpperLimit=1,
    Parameter=remap_2.Mapped,
    stops=[0.2: RGB(46, 139, 87), 0.595: RGB(154, 205, 50), 0.805: RGB(255, 215, 0), 1: RGB(255, 255, 255), 1: RGB(255, 255, 192), 1: RGB(255, 255, 255)])
panel_29 = Panel("""Very High (0-5)
High (6-12)
Medium (13-19)
Low (>19)""")
panel_30 = Panel("""Very High (0-5)
High (6-12)
Medium (13-19)
Low (>19)""")
rec = Rectangle({Plane=PlaneXY(213.5, 291.5, 0), Size=Domain2(u=-7.5..7.5, v=-81.5..81.5)})
rec_2 = Rectangle({Plane=PlaneXY(213.5, 291.5, 0), Size=Domain2(u=-7.5..7.5, v=-81.5..81.5)})

# ----
# ECOLOGICAL CONNECTIVITY
preview_2 = CustomPreview(Geometry=subsrf_2, Material=flatten(gradient_2))

move_5 = Move(Geometry=rec, Motion=X)  # -> Geometry, Transform

legend = Legend(
    Colour=[ColourSwatch(SwatchColor=RGB(255, 255, 192)), ColourSwatch(SwatchColor=RGB(255, 255, 130)), ColourSwatch(SwatchColor=RGB(148, 239, 143)), ColourSwatch(SwatchColor=RGB(1, 156, 206))],
    Tags=panel_30,
    Rectangle=move_5.Geometry,
    LegendType=101)

move_6 = Move(Geometry=rec_2, Motion=X_2)  # -> Geometry, Transform

legend_2 = Legend(
    Colour=[ColourSwatch(SwatchColor=RGB(38, 114, 71)), ColourSwatch(SwatchColor=RGB(144, 199, 53)), ColourSwatch(SwatchColor=RGB(253, 215, 1)), ColourSwatch(SwatchColor=RGB(255, 249, 159))],
    Tags=panel_29,
    Rectangle=move_6.Geometry,
    LegendType=101)

# ----
# COLORS
ma_15 = MassAddition(Input=[habitat_unit_2, habitat_unit_garden, habitat_unit_5])  # -> Result, PartialResults

# ----
# LANDSCAPE
panel_31 = Panel(ma_15.Result)

ma_16 = MassAddition(Input=[panel_22, panel_31, panel_27, panel_5])  # -> Result, PartialResults

# ----
# HABITAT UNIT
panel_32 = Panel(ma_16.Result)

panel_33 = Panel([panel_17, panel_32])
chart_7 = CreateChart(Data=panel_33, Names=panel_23, Title="HABITAT UNIT", ChartType=1)
addelems = AddElements(Window=launchwin, Elements=flatten([chart_7, stack_2, stack_3, stack]), DoVLChecking=True)  # -> AddedElements, ElementNames

# ----
# TREES LANSCAPE
number_slider_17 = Slider(0.3, range=0..1)
pop2d = Populate2D(Region=boundary_21, Count=how_many_trees_2, Seed=1)
sph = Sphere(Base=pop2d, Radius=Slider(4, range=0..10))
Z_6 = UnitZ(Factor=Slider(10, range=0..10))
move_7 = Move(Geometry=sph, Motion=Z_6)  # -> Geometry, Transform
cyl = Cylinder(Base=pop2d, Radius=number_slider_17, Length=Slider(10, range=0..10))
brep_3 = Brep([move_7.Geometry, cyl])

# ---- group: HIGHWAY
number_slider_18 = Slider(0, range=0..10)
# Use this features if you do urban planning.
# This will provide urban trees area and wilderness (woodland, etc) in large scale
colour_swatch = ColourSwatch(SwatchColor=RGB(171, 175, 162))

# ----
offset_5 = OffsetCurve(Curve=area_plot_neighborhoof, Distance=number_slider_18, Corners=1)
loft_2 = Loft(
    Curves=flatten([offset_5, area_plot_neighborhoof]),
    Options={Adjust=False, Closed=False, LoftEnds=0, LoftSimp=0, LoftType=0, Rebuild=10, Refit=0.01})

# ---- group: HIGHWAY (continued)
custom_preview_lineweights_14 = CustomPreviewLineweights(Geometry=loft_2, Shader=colour_swatch, Absolute=False)

# ----
# Building visualisation
mjoin = MeshJoin(Meshes=brep_2)
demesh = DeconstructMesh(Mesh=mjoin)  # -> Vertices, Faces, Colours, Normals
pdecon = Deconstruct(Point=demesh.Vertices)  # -> XComponent, YComponent, ZComponent
sort = SortList(Keys=pdecon.ZComponent, ValuesA=demesh.Vertices)  # -> flatten(Keys), flatten(ValuesA)
item_17 = ListItem(List=sort.Keys, Index=0, Wrap=True)
panel_34 = Panel(item_17)
panel_35 = Panel(pdecon.ZComponent)

gradient_3 = Gradient(
    LowerLimit=panel_34,
    UpperLimit=Slider(50, range=0..100),
    Parameter=panel_35,
    stops=[0: RGB(0, 128, 0), 0.429: RGB(255, 255, 0), 0.963: RGB(255, 0, 0)])

conmesh = ConstructMesh(Vertices=demesh.Vertices, Faces=demesh.Faces, Colours=gradient_3)

# ----
# Building visualisation
mjoin_2 = MeshJoin(Meshes=brep)
demesh_2 = DeconstructMesh(Mesh=mjoin_2)  # -> Vertices, Faces, Colours, Normals
pdecon_2 = Deconstruct(Point=demesh_2.Vertices)  # -> XComponent, YComponent, ZComponent
sort_2 = SortList(Keys=pdecon_2.ZComponent, ValuesA=demesh_2.Vertices)  # -> flatten(Keys), flatten(ValuesA)
item_18 = ListItem(List=sort_2.Keys, Index=0, Wrap=True)
panel_36 = Panel(item_18)
panel_37 = Panel(pdecon_2.ZComponent)

gradient_4 = Gradient(
    LowerLimit=panel_36,
    UpperLimit=Slider(50, range=0..100),
    Parameter=panel_37,
    stops=[0: RGB(0, 128, 0), 0.429: RGB(255, 255, 0), 0.963: RGB(255, 0, 0)])

conmesh_2 = ConstructMesh(Vertices=demesh_2.Vertices, Faces=demesh_2.Faces, Colours=gradient_4)

# ----
# TREES GREENROOF
number_slider_19 = Slider(0.3, range=0..1)
pop2d_2 = Populate2D(Region=boundary_15, Count=how_many_trees_3, Seed=1)
cyl_2 = Cylinder(Base=pop2d_2, Radius=number_slider_19, Length=Slider(3, range=0..10))
Z_7 = UnitZ(Factor=Slider(6, range=0..10))

sph_2 = Sphere(Base=pop2d_2, Radius=Slider(3, range=0..10))

move_8 = Move(Geometry=sph_2, Motion=Z_7)  # -> Geometry, Transform
brep_4 = Brep([move_8.Geometry, cyl_2])

custom_preview_lineweights_15 = CustomPreviewLineweights(Geometry=brep_3, Shader=ColourSwatch(SwatchColor=RGB(77, 208, 85)), Absolute=False)
custom_preview_lineweights_16 = CustomPreviewLineweights(Geometry=brep_4, Shader=ColourSwatch(SwatchColor=RGB(165, 241, 182)), Absolute=False)
